# Dynamo graph Avoid_Red_Ball - Topologic_CellComplex_Cluster_Dictionaries_ShortestPath_EdgeKey.dyn "Topologic_CellComplex_Cluster_Dictionaries" (Dynamo 2.7.0.8717)
# packages: Topologic 1.3.4

byCorners = Cuboid.ByCorners()
code_block = CodeBlock { 0..3..1; }
translate = Geometry.Translate(geometry=byCorners, xTranslation=code_block, yTranslation=code_block, zTranslation=code_block, lacing=CrossProduct)
flatten = List.Flatten(list=translate)
byGeometry = Topologic.Topology.ByGeometry(geometry=flatten)
byCells = Topologic.CellComplex.ByCells(cells=byGeometry)
edges = Topologic.CellComplex.Edges(cellComplex=byCells)
flatten_2 = List.Flatten(list=edges)
byTopologies = Topologic.Cluster.ByTopologies(topologies=flatten_2)
code_block_2 = CodeBlock { 0.5; }
vertexAtParameter = Topologic.Utilities.EdgeUtility.VertexAtParameter(edge=flatten_2, u=code_block_2)
code_block_3 = CodeBlock { "distance"; }
integer_slider = IntegerSlider(0, range=0..4 step 1)
byCoordinates = Point.ByCoordinates(x=integer_slider, y=integer_slider, z=integer_slider)
byGeometry_2 = Topologic.Topology.ByGeometry(geometry=byCoordinates)
distance = Topologic.Utilities.VertexUtility.Distance(vertex=byGeometry_2, topology=flatten_2)
code_block_4 = CodeBlock(x=distance) { 50-x*x; }
byKeysValues = DesignScript.Builtin.Dictionary.ByKeysValues(keys=code_block_3, values=code_block_4, lacing=Longest)
type = Topologic.Edge.Type()
setDictionaries = Topologic.Topology.SetDictionaries(topology=byTopologies, selectors=vertexAtParameter, dictionaries=byKeysValues, typeFilter=type)
edges_2 = Topologic.Topology.Edges(topology=setDictionaries)
dictionary = Topologic.Topology.Dictionary(topology=edges_2)
geometry = Topologic.Topology.Geometry(topology=edges)
byTopology = Topologic.Graph.ByTopology(topology=setDictionaries)
lastItem = List.LastItem(list=code_block)
code_block_5 = CodeBlock { 1; }
add = lastItem + code_block_5
code_block_6 = CodeBlock { 0; 1; }
verticesAtCoordinates = Topologic.Graph.VerticesAtCoordinates(graph=byTopology, x=add, y=code_block_6.out0, z=code_block_6.out0)
verticesAtCoordinates_2 = Topologic.Graph.VerticesAtCoordinates(graph=byTopology, x=code_block_6.out0, y=add, z=add)
code_block_7 = CodeBlock(v1=verticesAtCoordinates, v2=verticesAtCoordinates_2) { v1[0]; v2[0]; }
code_block_8 = CodeBlock { "distance"; }
shortestPath = Topologic.Graph.ShortestPath(graph=byTopology, startVertex=code_block_7.out0, endVertex=code_block_7.out1, edgeKey=code_block_8)
color_palette = ColorPalette({R: 127, G: 255, B: 0, A: 255})

# group: Visuals
geometry_2 = Topologic.Topology.Geometry(topology=shortestPath)
curves = PolyCurve.Curves(polyCurve=geometry_2)
startPoint = Curve.StartPoint(curve=curves)
endPoint = Curve.EndPoint(curve=curves)
code_block_9 = CodeBlock { 0.05; }
byPointsRadius = Cylinder.ByPointsRadius(startPoint=startPoint, endPoint=endPoint, radius=code_block_9)
byGeometryColor = Modifiers.GeometryColor.ByGeometryColor(geometry=byPointsRadius, color=color_palette)
geometry_3 = Topologic.Topology.Geometry(topology=code_block_7.out0)
code_block_10 = CodeBlock { 0.2; }
byCenterPointRadius = Sphere.ByCenterPointRadius(centerPoint=geometry_3, radius=code_block_10)
geometry_4 = Topologic.Topology.Geometry(topology=code_block_7.out1)
byCenterPointRadius_2 = Sphere.ByCenterPointRadius(centerPoint=geometry_4, radius=code_block_10)

code_block_11 = CodeBlock { 0.2; }
byCenterPointRadius_3 = Sphere.ByCenterPointRadius(centerPoint=byCoordinates, radius=code_block_11)
color_palette_2 = ColorPalette({R: 255, G: 69, B: 0, A: 255})
byGeometryColor_2 = Modifiers.GeometryColor.ByGeometryColor(geometry=byCenterPointRadius_3, color=color_palette_2)
list_create = List.Create(item0=byCenterPointRadius, item1=byCenterPointRadius_2)
byGeometryColor_3 = Modifiers.GeometryColor.ByGeometryColor(geometry=list_create, color=color_palette)
