# Grasshopper definition 2D&3D_non-uniform_grid.gh (Grasshopper 1.0.7)
# plug-ins: VoxelTools

number_slider = Slider(150, range=0..200)
number_slider_2 = Slider(50, range=0..100)
inside_brep = Brep(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)
domain = Brep(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)
s1 = Slider(2, range=2..6)
s2 = Slider(6, range=1..6)
s3 = Slider(6, range=1..6)
rectangle = Rectangle(Plane=PlaneXY(0, 0, 0), XSize=number_slider, YSize=number_slider_2, Radius=0)  # -> Rectangle, Length
construct_domain² = ConstructDomain²(UMin=0, UMax=number_slider, VMin=0, VMax=number_slider_2)
bounding_box = BoundingBox(Content=domain, Plane=PlaneXY(0, 0, 0), UnionBox=False)  # -> graft(Box), Box_2
divide_domain² = DivideDomain²(Domain=construct_domain², UCount=s1, VCount=s1)
brep_join = BrepJoin(Breps=rectangle.Rectangle)  # -> Breps, Closed
x_divider = Slider(9, range=1..10)
y_divider = Slider(2, range=1..10)
z_divider = Slider(2, range=1..10)
deconstruct_box = DeconstructBox(Box=bounding_box.Box)  # -> Plane, X, Y, Z
isotrim = Isotrim(Surface=brep_join.Breps, Domain=divide_domain²)
X = Number(deconstruct_box.X)
Y = Number(deconstruct_box.Y)
Z = Number(deconstruct_box.Z)
brep_edges = BrepEdges(Brep=isotrim)  # -> Naked, Interior, NonManifold
x_divider_2 = Slider(5, range=1..20)
division = Division(A=[X, Y, Z], B=x_divider_2)  # -> simplify(graft(Result))
explode_tree = ExplodeTree(Data=division)  # -> Branch0, Branch1, Branch2
panel = Panel(division)
create_voxelgrid = CreateVoxelGrid(BoundingBox=bounding_box.Box, SizeX=explode_tree.Branch0, SizeY=explode_tree.Branch1, SizeZ=explode_tree.Branch2)
voxelategeometry = VoxelateGeometry(Geometry=bounding_box.Box, VoxelGrid=create_voxelgrid, Distance=0)  # -> simplify(VoxelGrid)
voxelgrid_to_boxes = VoxelGridToBoxes(VoxelGrid=voxelategeometry, Selection=Slider(1, range=-1..1))  # -> graft(Boxes), Points
curve = Curve([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])
collision_one_many = CollisionOneMany(Collider=brep_edges.Naked, Obstacles=curve)  # -> Collision, Index
create_set = CreateSet(List=collision_one_many.Collision)  # -> Set, Map
flip_matrix = FlipMatrix(Data=create_set.Set)
explode_tree_2 = ExplodeTree(Data=flip_matrix)  # -> Branch0, Branch1
gate_or = GateOr(A=explode_tree_2.Branch0, B=explode_tree_2.Branch1)
cull_pattern = CullPattern(List=isotrim, CullPattern=gate_or)  # -> graft(List)
cull_pattern_2 = CullPattern(List=divide_domain², CullPattern=gate_or)
brep_brep = BrepBrep(BrepA=inside_brep, BrepB=voxelgrid_to_boxes.Boxes)  # -> Curves, Points
deconstruct_brep = DeconstructBrep(Brep=voxelgrid_to_boxes.Boxes)  # -> simplify(Faces), Edges, Vertices
custom_preview = CustomPreview(Geometry=curve, Material=ColourSwatch(SwatchColor=RGB(255, 255, 255)))
divide_domain²_2 = DivideDomain²(Domain=cull_pattern_2, UCount=s2, VCount=s2)
curve_2 = Curve(brep_brep.Curves)
curve_3 = Curve(deconstruct_brep.Edges)
null_item = NullItem(Item=brep_brep.Curves)  # -> NullFlags, InvalidFlags, Description
# 3D Non-Uniform
collision_one_many_2 = CollisionOneMany(Collider=inside_brep, Obstacles=curve_2)  # -> Collision, Index
# 2D Non-Uniform
isotrim_2 = Isotrim(Surface=cull_pattern, Domain=divide_domain²_2)  # -> flatten(Surface)
# Without collision
cull_pattern_3 = CullPattern(List=voxelgrid_to_boxes.Boxes, CullPattern=null_item.NullFlags)  # -> flatten(List)
# With collision
cull_pattern_4 = CullPattern(List=voxelgrid_to_boxes.Boxes, CullPattern=collision_one_many_2.Collision)  # -> flatten(List)
solid_union = SolidUnion(Breps=cull_pattern_4)
bounding_box_2 = BoundingBox(Content=cull_pattern_4, Plane=PlaneXY(0, 0, 0), UnionBox=True)  # -> Box, Box_2
brep_edges_2 = BrepEdges(Brep=isotrim_2)  # -> Naked, Interior, NonManifold
deconstruct_box_2 = DeconstructBox(Box=bounding_box_2.Box)  # -> Plane, X, Y, Z
x_divider_3 = Slider(8, range=1..10)
y_divider_2 = Slider(3, range=1..10)
z_divider_2 = Slider(3, range=1..10)
collision_one_many_3 = CollisionOneMany(Collider=brep_edges_2.Naked, Obstacles=curve)  # -> Collision, Index
X_2 = Number(deconstruct_box_2.X)
Y_2 = Number(deconstruct_box_2.Y)
Z_2 = Number(deconstruct_box_2.Z)
create_set_2 = CreateSet(List=collision_one_many_3.Collision)  # -> Set, Map
division_2 = Division(A=[X_2, Y_2, Z_2], B=x_divider_2)  # -> simplify(graft(Result))
flip_matrix_2 = FlipMatrix(Data=create_set_2.Set)
explode_tree_3 = ExplodeTree(Data=division_2)  # -> Branch0, Branch1, Branch2
panel_2 = Panel(division_2)
explode_tree_4 = ExplodeTree(Data=flip_matrix_2)  # -> Branch0, Branch1
create_voxelgrid_2 = CreateVoxelGrid(BoundingBox=bounding_box_2.Box, SizeX=explode_tree_3.Branch0, SizeY=explode_tree_3.Branch1, SizeZ=explode_tree_3.Branch2)
gate_or_2 = GateOr(A=explode_tree_4.Branch0, B=explode_tree_4.Branch1)
cull_pattern_5 = CullPattern(List=flatten(divide_domain²_2), CullPattern=gate_or_2)
cull_pattern_6 = CullPattern(List=isotrim_2, CullPattern=gate_or_2)  # -> graft(List)
panel_3 = Panel(create_voxelgrid_2)
voxelategeometry_2 = VoxelateGeometry(Geometry=solid_union, VoxelGrid=create_voxelgrid_2, Distance=0)
divide_domain²_3 = DivideDomain²(Domain=cull_pattern_5, UCount=s3, VCount=s3)
voxelgrid_to_boxes_2 = VoxelGridToBoxes(VoxelGrid=voxelategeometry_2, Selection=Slider(1, range=-1..1))  # -> Boxes, Points
isotrim_3 = Isotrim(Surface=cull_pattern_6, Domain=divide_domain²_3)  # -> flatten(Surface)
deconstruct_brep_2 = DeconstructBrep(Brep=voxelgrid_to_boxes_2.Boxes)  # -> Faces, Edges, Vertices

unit_z = UnitZ(Factor=Slider(40, range=0..100))
move = Move(Geometry=deconstruct_brep_2.Edges, Motion=unit_z)  # -> Geometry, Transform

brep_edges_3 = BrepEdges(Brep=isotrim_3)  # -> Naked, Interior, NonManifold
curve_4 = Curve(deconstruct_brep_2.Edges)
collision_one_many_4 = CollisionOneMany(Collider=inside_brep, Obstacles=deconstruct_brep_2.Faces)  # -> flatten(Collision), Index
collision_one_many_5 = CollisionOneMany(Collider=brep_edges_3.Naked, Obstacles=curve)  # -> Collision, Index
cull_pattern_7 = CullPattern(List=voxelgrid_to_boxes_2.Boxes, CullPattern=collision_one_many_4.Collision)
panel_4 = Panel(collision_one_many_4.Collision)
create_set_3 = CreateSet(List=collision_one_many_5.Collision)  # -> Set, Map
flip_matrix_3 = FlipMatrix(Data=create_set_3.Set)
explode_tree_5 = ExplodeTree(Data=flip_matrix_3)  # -> Branch0, Branch1
gate_or_3 = GateOr(A=explode_tree_5.Branch0, B=explode_tree_5.Branch1)
cull_pattern_8 = CullPattern(List=isotrim_3, CullPattern=gate_or_3)  # -> graft(List)
