# Grasshopper definition JESS_Rhino8.gh (Grasshopper 1.0.8)
# plug-ins: RhinoCodePluginGH

python_3_script = Python3Script()  # -> out, a
# ---------- python_3_script: Python ----------
"""Grasshopper Script"""
# r: requests

import requests

# API endpoint URL
ApiBase = 'https://api.ensims.com/'
JeaApi = ApiBase + "jea_web/api/"
UserApi = ApiBase + 'users/api/'

# Test connection
r = requests.get(JeaApi + 'info')
# ---------- end python_3_script ----------
