# Grasshopper definition JESS_SERVER_API_Demo.gh (Grasshopper 1.0.7)
# plug-ins: Swiftlet

epw = FilePath("C:\EnergyPlusV23-1-0\WeatherData\USA_IL_Chicago-OHare.Intl.AP.725300_TMY3.epw")
idf = FilePath("C:\Users\thinkpad\Desktop\JEPLUS in GH\in.idf")
runidf = HBRunIDF(idf=idf, epw_file=epw, run=Toggle(True))  # -> out, sql, zsz, rdd, html; plug-in component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
roomenergyresult = HBReadRoomEnergyResult(sql=runidf.sql)  # -> cooling, heating, lighting, electric_equip, gas_equip, process, hot_water, fan_electric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; plug-in component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
hourlyplot = LBHourlyPlot(data=roomenergyresult.heating)  # -> out, mesh, legend, borders, labels, title, vis_set; plug-in component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
panel = Panel("""{
    "email": "bartlomiej.tokarzewski@gmail.com",
    "password": "bartekt1"
}""")
# API Base: https://api.ensims.com/
panel_2 = Panel("https://api.ensims.com/users/api/auth")
panel_3 = Panel("'session_token=eyJraWQiOiIxNTE4MTE0OTI2NTQ5IiwiYWxnIjoiUlMyNTYifQ.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.1wAbYr8VtLmxNIekSdtO4n3g6lnc99ZzulqMjwIwVVgQa8CIbnlbBhR8uan6VrVLpbtGk-yqHQrfwbNpejETbNAm3veVmwPpK0DaXmGwHWOaJ1OtlaVgok9am02wSfLqM3onk3ptLYRM7Q2z3wu_vpoqOsCZpANeiVAV_J5cMetxXoIk8Xgsb1ME2qD2LZOoZi5-vdNgiR4W30f_mgvZiEpWlWVfDRmHt04HT1wdx3bEQL5bRGS_V9jDerbrlqGteRt2tmfogVDAuChMD0CeEzMscCy0VVOkVJ-M3Dhfz8UoIv0iznvfLyy9obNBbVMimvpuE1ZCjzQQrQDs8B80PQ'")
create_text_body = CreateTextBody(
    Content=panel,
    IsHtmlChecked=False,
    IsJavascriptChecked=False,
    IsJsonChecked=True,
    IsTextChecked=False,
    IsXmlChecked=False)
post_request = POSTRequest(URL=panel_2, Body=create_text_body)  # -> Status, Content, Response
panel_4 = Panel(post_request.Content)
deconstruct_response = DeconstructResponse(Response=post_request.Response)  # -> Version, Status, Reason, Headers, IsSuccess, Content, ByteArray
deconstruct_http_header = DeconstructHttpHeader(Header=deconstruct_response.Headers)  # -> Key, Value
list_item = ListItem(List=deconstruct_http_header.Value, Index=0, Wrap=True)
user_api = Panel("https://api.ensims.com/users/api/checkin")
text_split = TextSplit(Text=list_item, Separators=";")
list_item_2 = ListItem(List=text_split, Index=0, Wrap=True)
create_http_header = CreateHttpHeader(Key="'Cookie'", Value=list_item_2)
create_text_body_2 = CreateTextBody(IsHtmlChecked=False, IsJavascriptChecked=False, IsJsonChecked=True, IsTextChecked=False, IsXmlChecked=False)
panel_5 = Panel(create_http_header)
post_request_2 = POSTRequest(URL=user_api, Body=create_text_body_2, Headers=create_http_header)  # -> Status, Content, Response
panel_6 = Panel(post_request_2.Content)
