# Grasshopper definition NetworkX-basics.gh (Grasshopper 1.0.7)
# plug-ins: VoxelTools, GH_CPython, Human

# To run this script correctly you need
# Voxeltools
# GH_CPython
# Python 3.X with NetworkX library
size = Slider(10, range=0..20)
size_2 = Slider(0.5, range=0..10)
box = DomainBox(Base=PlaneXY(0, 0, 0), X=size, Y=size, Z=size)
voxcreate = CreateVoxelGrid(BoundingBox=box, SizeX=size_2, SizeY=size_2, SizeZ=size_2)
voxgeo = VoxelateGeometry(Geometry=box, VoxelGrid=voxcreate, Distance=0)
voxbox = VoxelGridToBoxes(VoxelGrid=voxgeo, Selection="-1")  # -> Boxes, Points
# Why shortest_path that uses dijkstra is faster than dijkstra_path?
# https://networkx.github.io/documentation/stable/reference/algorithms/shortest_paths.html
panel = Panel("""dijkstra_path
astar_path
bellman_ford_path
shortest_path""")
debrep = DeconstructBrep(Brep=voxbox.Boxes)  # -> Faces, flatten(Edges), Vertices
edges = GhPythonScript(edges=debrep.Edges)  # -> StartPoint, EndPoint; inputs edges: list of Curve
# ---------- edges: Python ----------
__author__ = "amd"
__version__ = "2020.07.10"
import rhinoscriptsyntax as rss

#output edges
StartPoint = ["({})".format(str(rss.CurveStartPoint(edge, segment_index=-1))) for edge in edges]
EndPoint = ["({})".format(str(rss.CurveEndPoint(edge, segment_index=-1))) for edge in edges]
# ---------- end edges ----------
list = ItemSelector(panel, {"dijkstra_path", "astar_path", "bellman_ford_path", "shortest_path"}, selected="shortest_path")
move = Move(Geometry=debrep.Edges, Motion="{0,15,0}")  # -> Geometry, Transform
graph_byedges = GraphByEdges(StartPoint=edges.StartPoint, EndPoint=edges.EndPoint, SampleSize=Slider(200, range=0..200), Algorithm=list)  # -> output, NodesCount, EdgeCount, ShortestPaths; inputs StartPoint: list, EndPoint: list, SampleSize: list, Algorithm: list
# ---------- graph_byedges: Python ----------
# -*- coding: utf-8 -*-

import networkx as nx
G = nx.Graph()

if len(StartPoint) == len(EndPoint):
    for x in range(len(StartPoint)):
        G.add_edge(StartPoint[x], EndPoint[x])
else:
    output = "StartPoint and EndPoint count must be equal"

NodesCount = G.number_of_nodes()
EdgeCount = G.number_of_edges()

from random import choice
ShortestPaths =[]
for i in range(SampleSize):
    #generate start & end points
    random_start = choice(list(G.nodes()))
    random_end = choice(list(G.nodes()))
    #print(random_start, random_end)
    
    #find paths
    ShortestPath = eval("nx."+Algorithm+"(G, random_start, random_end)")
    ShortestPath = str(ShortestPath).replace("), ",";").replace("(","").replace("[","").replace("]","").replace(")","")
    ShortestPaths.append(ShortestPath)

ShortestPaths = [Path.replace(", ","_") for Path in ShortestPaths]

""" 
Python Script
Created on  Friday July 2020 11:43:57 
@author:  amd 

[desc]
Description of the plugin Here
Write here any thing... 
[/desc]

ARGUMENTS:
----------
<inp> 
    SampleSize :[optional] - [type = int] - [default = 1] 
    Descripe your input here 
        * bullet point.
        * bullet point
</inp>
<inp> 
    Algorithm :[optional] - [type = string] - [default = shortest_path] 
    Descripe your input here 
        * astar_path
        * dijkstra_path
        * bellman_ford_path
        * shortest_path
</inp>

RETURN:
----------
    <out>
        output_ : indicate your output description here. \n refers to a new line.
    </out>

"""
# ---------- end graph_byedges ----------
dataprocessing = GhPythonScript(paths=graph_byedges.ShortestPaths)  # -> points
# ---------- dataprocessing: Python ----------
__author__ = "amd"
__version__ = "2020.07.11"

import rhinoscriptsyntax as rs
import Rhino.Geometry as rg

path = paths.replace("'","").replace("_",",").split(";")
points=[]
for point in path:
    point = point.split(",")
    points.append(rg.Point3d(float(point[0]),float(point[1]),float(point[2])))
#print(points)
# ---------- end dataprocessing ----------
panel_2 = Panel(graph_byedges.NodesCount)
panel_3 = Panel(graph_byedges.EdgeCount)
pline = PolyLine(Vertices=dataprocessing, Closed=False)  # -> flatten(Polyline)
